# Grasshopper definition coordConvert.gh (Grasshopper 0.9.76)
# plug-ins: MeerkatGIS

shapefile = ImportShapefile(OnOff=Toggle(False))
file = ReadFile(File="D:\WORK\piloto\Climate\ClimateDataETL\stationGroups\cities.csv", PerLineParse=True)
path = FilePath("D:\WORK\piloto\Climate\ClimateDataETL\stationGroups\col_admbnda_adm1_unodc_ocha\col_admbnda_adm1_unodc_ocha.mkgis")
split = TextSplit(Text=file, Separators=",")
panel = Panel("""orinoquia
andes
pacifico
caribe
amazonia""")
parse_mkgis = ParseMeerkatFile(MeerkatFile=path)  # -> DateCropped, UserAndMachineNamed, PathForFiles, ShapeType, ShapeCountInSource, BoundsInPointSpace, BoundsInLatLong, FieldNames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
item = ListItem(List=split, Index=0, Wrap=True)  # -> flatten(Item)
item_2 = ListItem(List=split, Index=Slider(1, range=0..1), Wrap=True)  # -> flatten(Item)
item_3 = ListItem(List=split, Index=Slider(2, range=0..10), Wrap=True)  # -> flatten(Item)
number_slider = Slider(0.01, range=0..0.01)
crv = Curve([<curve referenced from the Rhino model> x5])
pt = ConstructPoint(XCoordinate=item, YCoordinate=item_2, ZCoordinate=0)
pline = PolyLine(Vertices=parse_mkgis.GeometryPerShape, Closed=False)
tag = TextTag3D(Location=pt, Text=item_3, Size=Slider(0.1, range=0..0.1), Justification=7)
pt_2 = Point(<point referenced from the Rhino model>)
vec2pt = Vector2Pt(PointA=<geometry referenced from the Rhino model>, PointB=pt_2, Unitize=False)  # -> Vector, Length
pt_3 = Point(<point referenced from the Rhino model>)
move = Move(Geometry=crv, Motion=vec2pt.Vector)  # -> Geometry, Transform
pdecon = Deconstruct(Point=pt_3)  # -> XComponent, YComponent, ZComponent
file_2 = ReadFile(File="D:\WORK\piloto\Climate\ClimateDataETL\stationGroups\writeStationCoords.txt", PerLineParse=True)
scale = Scale(Geometry=move.Geometry, Center=pt_2, Factor=Slider(0.0262, range=0..0.03))  # -> Geometry, Transform
panel_2 = Panel(pdecon.XComponent)
cp = ControlPoints(Curve=scale.Geometry)  # -> Points, Weights, Knots
split_2 = TextSplit(Text=file_2, Separators=",")
lng = ListLength(List=cp.Points)
item_4 = ListItem(List=split_2, Index=0, Wrap=True)
item_5 = ListItem(List=split_2, Index=Slider(1, range=0..1), Wrap=True)
division = Division(A=lng, B=Slider(5, range=0..10))
pt_4 = ConstructPoint(XCoordinate=item_5, YCoordinate=item_4, ZCoordinate=0)
round = Round(Number=division)  # -> simplify(Nearest), Floor, Ceiling
reb = RebuildCurve(Curve=graft(scale.Geometry), Degree=Slider(1, range=0..1), Count=round.Nearest, Tangents=False)
cp_2 = ControlPoints(Curve=scale.Geometry)  # -> Points, Weights, Knots
cls = Closed(Curve=reb)  # -> Closed, Periodic
c_script = CSharpScript(coords=cp_2.Points, names=panel)  # -> out, A; inputs coords: tree of Point3d, names: list
# ---------- c_script: C# ----------
    StreamWriter sw = new StreamWriter(@"D:\WORK\piloto\Climate\ClimateDataETL\stationGroups\regions.csv");
    for(int i = 0;i < coords.BranchCount;i++)
    {
      sw.Write(names[i] + ",");
      for(int j = 0;j < coords.Branch(i).Count;j++)
      {
        if(j == coords.Branch(i).Count - 1) sw.WriteLine(coords.Branch(i)[j].X + "," + coords.Branch(i)[j].Y);
        else sw.Write(coords.Branch(i)[j].X + "," + coords.Branch(i)[j].Y + ",");
      }
    }
    sw.Close();
# ---------- end c_script ----------
panel_3 = Panel(cls.Periodic)
